# Grasshopper definition algorithm.gh (Grasshopper 0.9.80)

z = Slider(7, range=3..7)
x_y_thickness = Slider(2.612, range=2..3)
width = Slider(136, range=130..140)
temple_height = Slider(4.523, range=0..10)
side_thickness = Slider(6.25, range=5.75..6.25)
bottom_temple = Slider(129.908, range=0..200)
top_temple = Slider(-4, range=-50..100)
bridge_thickness = Slider(4.5, range=4.5..5.5)
pd = Slider(66, range=65..70)
bridge_height = Slider(3.143, range=0..7)
bottom_bridge = Slider(72.217, range=0..100)
top_bridge = Slider(52, range=0..100)
lens = Geometry(<curve referenced from the Rhino model>)

# ---- group: inner frame
connect = ConnectCurves(Curves=lens, Continuity=2, Close=True, Bulge=1)
closed_lens = Geometry(connect)
area = Area(Geometry=closed_lens)  # -> Area, Centroid
centerpoint = Point(area.Centroid)
pdecon = Deconstruct(Point=centerpoint)  # -> XComponent, YComponent, ZComponent
number = Number(-1)
number_2 = Number(-1)
multiplication = Multiplication(A=pdecon.YComponent, B=number)
multiplication_2 = Multiplication(A=number_2, B=pdecon.XComponent)
X = UnitX(Factor=multiplication_2)
Y = UnitY(Factor=multiplication)
move = Move(Geometry=lens, Motion=X)  # -> Geometry, Transform
move_2 = Move(Geometry=move.Geometry, Motion=Y)  # -> Geometry, Transform
inner_lens = Geometry(move_2.Geometry)

# ---- group: center line
_0_0_0 = Point(Point(0, 0, 0))
Y_2 = UnitY(Factor=bridge_thickness)
move_3 = Move(Geometry=_0_0_0, Motion=Y_2)  # -> Geometry, Transform
bottom_center_bridge = Point(_0_0_0)
top_center_bridge = Point(move_3.Geometry)
Y_3 = UnitY(Factor=bridge_height)
move_4 = Move(Geometry=bottom_center_bridge, Motion=Y_3)  # -> Geometry, Transform
move_5 = Move(Geometry=top_center_bridge, Motion=Y_3)  # -> Geometry, Transform
ln = Line(StartPoint=move_4.Geometry, EndPoint=move_5.Geometry)
center_line = Geometry(ln)

# ---- group: side
division = Division(A=width, B=2)
Y_4 = UnitY(Factor=temple_height)
division_2 = Division(A=width, B=2)
_0 = Number(0)
_0_2 = Number(0)
_0_3 = Number(0)
pt = ConstructPoint(XCoordinate=division, YCoordinate=side_thickness, ZCoordinate=_0)
pt_2 = ConstructPoint(XCoordinate=division_2, YCoordinate=_0_2, ZCoordinate=_0_3)
move_6 = Move(Geometry=pt, Motion=Y_4)  # -> Geometry, Transform
move_7 = Move(Geometry=pt_2, Motion=Y_4)  # -> Geometry, Transform
top_right_point = Point(move_6.Geometry)
bottom_right_point = Point(move_7.Geometry)
ln_2 = Line(StartPoint=move_6.Geometry, EndPoint=move_7.Geometry)
side = Geometry(ln_2)

# ---- group: move PD
_2 = Number(2)
division_3 = Division(A=pd, B=_2)
X_2 = UnitX(Factor=division_3)
move_8 = Move(Geometry=inner_lens, Motion=X_2)  # -> Geometry, Transform

# ---- group: outer frame
offset = Offset(Curve=move_8.Geometry, Distance=x_y_thickness, Plane=PlaneXY(0, 0, 0), Corners=1)
outer_frame = Geometry(flatten(offset))

# ---- group: temple
side_2 = Geometry(side)
end = EndPoints(Curve=side_2)  # -> Start, End
top_point = Point(end.Start)
bottom_point = Point(end.End)
X_3 = UnitX(Factor=-1)
move_9 = Move(Geometry=top_point, Motion=X_3)  # -> Geometry, Transform
X_4 = UnitX(Factor=-1)
move_10 = Move(Geometry=bottom_point, Motion=X_4)  # -> Geometry, Transform
eval = EvaluateCurve(Curve=outer_frame, Parameter=top_temple)  # -> Point, Tangent, Angle
addition = Addition(A=top_temple, B=1)
eval_2 = EvaluateCurve(Curve=outer_frame, Parameter=addition)  # -> Point, Tangent, Angle
eval_3 = EvaluateCurve(Curve=outer_frame, Parameter=bottom_temple)  # -> Point, Tangent, Angle
addition_2 = Addition(A=bottom_temple, B=1)
eval_4 = EvaluateCurve(Curve=outer_frame, Parameter=addition_2)  # -> Point, Tangent, Angle
intcrv = Interpolate(Vertices=[top_point, move_9.Geometry, eval.Point, eval_2.Point], Degree=3, Periodic=False, KnotStyle=1)  # -> Curve, Length, Domain
ln_3 = Line(StartPoint=eval_2.Point, EndPoint=eval_3.Point)
intcrv_2 = Interpolate(Vertices=[eval_3.Point, eval_4.Point, move_10.Geometry, bottom_point], Degree=3, Periodic=False, KnotStyle=1)  # -> Curve, Length, Domain
join = JoinCurves(Curves=[side_2, ln_3, intcrv.Curve, intcrv_2.Curve], Preserve=False)

# ---- group: bridge
center_line_2 = Line(center_line)
end_2 = EndPoints(Curve=center_line_2)  # -> Start, End
bottom_point_2 = Point(end_2.Start)
top_point_2 = Point(end_2.End)
X_5 = UnitX(Factor=0.1)
move_11 = Move(Geometry=top_point_2, Motion=X_5)  # -> Geometry, Transform
X_6 = UnitX(Factor=0.01)
move_12 = Move(Geometry=bottom_point_2, Motion=X_6)  # -> Geometry, Transform
eval_5 = EvaluateCurve(Curve=outer_frame, Parameter=top_bridge)  # -> Point, Tangent, Angle
eval_6 = EvaluateCurve(Curve=outer_frame, Parameter=bottom_bridge)  # -> Point, Tangent, Angle
addition_3 = Addition(A=top_bridge, B=1)
eval_7 = EvaluateCurve(Curve=outer_frame, Parameter=addition_3)  # -> Point, Tangent, Angle
addition_4 = Addition(A=bottom_bridge, B=1)
eval_8 = EvaluateCurve(Curve=outer_frame, Parameter=addition_4)  # -> Point, Tangent, Angle
intcrv_3 = Interpolate(Vertices=[eval_8.Point, eval_6.Point, move_12.Geometry, bottom_point_2], Degree=3, Periodic=False, KnotStyle=1)  # -> Curve, Length, Domain
intcrv_4 = Interpolate(Vertices=[eval_5.Point, eval_7.Point, move_11.Geometry, top_point_2], Degree=3, Periodic=False, KnotStyle=1)  # -> Curve, Length, Domain

# ----
ln_4 = Line(StartPoint=eval_8.Point, EndPoint=eval_5.Point)

# ---- group: bridge (continued)
join_2 = JoinCurves(Curves=[center_line_2, intcrv_3.Curve, intcrv_4.Curve, ln_4], Preserve=False)

# ---- group: right surface
outer_frame_2 = Geometry(outer_frame)
temple = Geometry(join)
brige = Geometry(join_2)
inner_frame = Geometry(move_8.Geometry)
runion = RegionUnion(Curves=flatten([outer_frame_2, brige, temple]))
boundary = BoundarySurfaces(Edges=inner_frame)
boundary_2 = BoundarySurfaces(Edges=runion)
sdiff = SolidDifference(BrepsA=boundary_2, BrepsB=boundary)
mirror = Mirror(Geometry=sdiff, Plane=PlaneYZ(0, 0, 0))  # -> Geometry, Transform
frame = Geometry([mirror.Geometry, sdiff])
Z = UnitZ(Factor=z)
extr = Extrude(Base=frame, Direction=Z)
