# Grasshopper definition temple.gh (Grasshopper 0.9.80)

temple_height = Slider(4, range=0..10)
cylindar_length = Slider(10, range=0..10)
thickness = Slider(2, range=2..10)
temple = Geometry(<curve referenced from the Rhino model>)

# ---- group: temple
end = EndPoints(Curve=temple)  # -> Start, End
pt = Point(end.Start)
Y = UnitY(Factor=temple_height)
move = Move(Geometry=pt, Motion=Y)  # -> Geometry, Transform
ln = Line(StartPoint=pt, EndPoint=move.Geometry)
division = Division(A=thickness, B=2)
swp1 = Sweep1(Rail=temple, Sections=ln, Miter=1)
multiplication = Multiplication(A=division, B=-1)
Z = UnitZ(Factor=division)
Z_2 = UnitZ(Factor=multiplication)
extr = Extrude(Base=swp1, Direction=[Z, Z_2])

# ---- group: cylinder
division_2 = Division(A=temple_height, B=2)
Y_2 = UnitY(Factor=division_2)
move_2 = Move(Geometry=end.Start, Motion=Y_2)  # -> Geometry, Transform
circle = CircleCNR(Center=move_2.Geometry, Normal=Vector(0, 0, 1), Radius=Slider(2.5, range=0..10))
xz = XZPlane(Origin=Point(0, 0, 0))
rotate = Rotate(Geometry=circle, Angle=1.570796327, Plane=xz)  # -> Geometry, Transform
geo = Geometry(rotate.Geometry)
boundary = BoundarySurfaces(Edges=geo)
X = UnitX(Factor=cylindar_length)
extr_2 = Extrude(Base=boundary, Direction=X)

# ----
sunion = SolidUnion(Breps=[extr, extr_2])
